# Grasshopper definition radial_contour.ghx (Grasshopper 0.8.10)

crv = Curve(
    Vertices=[Point(-21.88013392, 0, 13.77807596), Point(-15.65482385, 0, 7.461217216), Point(-15.56327517, 0, 4.989402924), Point(-18.85902756, 0, -0.8697124362), Point(-25.45053234, 0, -7.827411926), Point(-27.18995722, 0, -13.04568654), Point(-24.71814292, 0, -15.15130613), Point(-21.60548789, 0, -15.60904951)],
    Degree=3,
    Periodic=False)  # -> Curve, Length, Domain
revsrf = Revolution(
    Curve=crv.Curve,
    Axis=Line((-0.549292065, 0, -14.14427067), (-0.6408407425, 0, 14.51046538)),
    Interval=Domain(0, 6.283185307))
python = PythonScript(brep=revsrf, count=Slider(500, range=1..1000), parallel=Toggle(True), GhMemory=0)  # -> out, duration, curves
# ---------- python: Python ----------
import System.Threading.Tasks as tasks
import Rhino
import rhinoscriptsyntax as rs
import time, math
import scriptcontext


def radial_contour(brep, parallel, slice_count=360):
    """Generate series of curve slices through a brep by rotating a plane
    multiple times and intersecting that plane with the brep. This function
    demonstrates the use of .NET Parallel.For in order to run the function
    in parallel
    Parameters:
        brep = the Brep to contour
        parallel = If True, this function will compute intersections in multiple
          threads using Parallel.For. If False, all intersections will be performed
          on a single thread
        slice_count = number of slices to generate. Slices are evenly distributed
          over a full circle
    """
    if not brep: return
    
    results = range(slice_count)
    rotation_axis = Rhino.Geometry.Vector3d(0,1,0)
    intersect_tol = scriptcontext.doc.ModelAbsoluteTolerance
    # local function that does the intersection work. This function is called
    # once for each angle in "slice_count" and needs to be thread-safe
    def slice_brep_at_angle(i):
        try:
            angle_rad = i/slice_count * 2.0 * math.pi
            plane = Rhino.Geometry.Plane.WorldXY
            plane.Rotate(angle_rad, rotation_axis, Rhino.Geometry.Point3d.Origin)
            rc, crvs, pts = Rhino.Geometry.Intersect.Intersection.BrepPlane(brep, plane, intersect_tol)
            if rc: results[i] = crvs
            else: results[i] = None
        except:
            pass

    if parallel:
        tasks.Parallel.ForEach(xrange(slice_count), slice_brep_at_angle)
    else:
        for i in xrange(slice_count): slice_brep_at_angle(i)

    return results

if brep and count:
    start = time.time()
    slices = radial_contour(brep, parallel, int(count))
    end = time.time()
    duration = end-start
    if slices:
        curves = []
        for curveset in slices:
            if curveset:
                for curve in curveset: curves.append(curve)
# ---------- end python ----------
panel = Panel(python.duration)
